% Simulink data dictionary constants.sldd

bath_area = 301.3075
slag_specific_heat_capacity = 1560
matte_specific_heat_capacity = 1000
water_specific_heat_capacity = 4186
air_specific_heat_capacity = 1005
slag_matte_heat_transfer_coefficient = 60
slag_charge_heat_transfer_coefficient = 80
slag_in_temperature = 830
matte_density = 4.5
slag_density = 2.8
concentrate_density = 1.2
offgas_fraction = 0.0015
h_evap_water = 2260
cp_delta_T = 2379
steam_evap_fraction = 0.09